# Grasshopper definition FloorPlanGenerator_Combined.gh (Grasshopper 1.0.7)

# {"type":"feature","geometry":{"type":"Polygon","coordinates":[[87.70273541814993,183.90726661663072],[-127.97439964076979,-140.95082477916952],[-115.44543743817695,-161.53411982628634],[155.7171016607968,118.57767798882516]]},"properties":{"corridorType":"double loaded","typology":"courtyard","floorsInput":4}}
# 
# {"type":"feature","geometry":{"type":"Polygon","coordinates":[[-21.180240118411053,-62.049154149711185],[45.94023913007462,3.2814456521482054],[-24.75999901166362,58.76770849756303]]},"properties":{"corridorType":"single loaded","typology":"courtyard","floorsInput":6}}
# 
# {"type":"feature","geometry":{"type":"Polygon","coordinates":[[5.182896362326505,37.84632955224037],[-41.35130982604392,-12.043708813176002],[-8.91159878126646,-40.680143390634726],[18.829947215646676,-10.25393165208483],[2.945674910962542,2.2745084755533598],[23.304390118374602,22.856945828101818]]},"properties":{"corridorType":"single loaded","typology":"courtyard","floorsInput":2}}
# 
# {"type":"feature","geometry":{"type":"Polygon","coordinates":[[-49.60481263990175,-0.8388637988709429],[-6.654986137709479,-46.92044848351473],[10.345986852741628,-48.71002458777275],[43.45314478151484,-16.945048737193044],[47.479691016095366,0.055924253258062856],[9.00380477454812,48.37447906822437],[-7.102380163773983,48.821873094288875],[-46.92044848351473,16.162109191580164]]},"properties":{"corridorType":"double loaded","typology":"courtyard","floorsInput":5}}
# '{0;0}': [{'type': 'System.String', 'data': '"67"'}],
#                 '{0;1}': [{'type': 'System.String', 'data': '"39"'}],
#                 '{0;2}': [{'type': 'System.String', 'data': '"23"'}],
#                 '{0;3}': [{'type': 'System.String', 'data': '"-7"'}],
#                 '{0;4}': [{'type': 'System.String', 'data': '"-19"'}],
#                 '{0;5}': [{'type': 'System.String', 'data': '"-53"'}],
#                 '{0;6}': [{'type': 'System.String', 'data': '"-50"'}]
#             }
#         },
#         {
#             'ParamName': 'RH_OUT:y',
#             'InnerTree': {
#                 '{0;0}': [{'type': 'System.String', 'data': '"35"'}],
#                 '{0;1}': [{'type': 'System.String', 'data': '"69"'}],
#                 '{0;2}': [{'type': 'System.String', 'data': '"-4"'}],
#                 '{0;3}': [{'type': 'System.String', 'data': '"26"'}],
#                 '{0;4}': [{'type': 'System.String', 'data': '"-44"'}],
#                 '{0;5}': [{'type': 'System.String', 'data': '"-7"'}],
#                 '{0;6}': [{'type': 'System.String', 'data': '"-75"'}]
panel = Panel("""87
-127
-115
155""")
panel_2 = Panel("""183
-140
-161
118""")
defaultvalue = Panel("Polygon")
corridorwidth_m = Slider(2.5, range=0..2.5)
buildingdepth_m = Slider(25, range=0..100)
randomreduceby = Slider(5, range=0..10)
num = Number(graft(panel_2))
num_2 = Number(graft(panel))
floorheight = Slider(4, range=2.2..4)

# ---- group: RH_IN:x
txt = Text(num_2)

# ---- group: RH_IN:y
txt_2 = Text(num)

# ---- group: RH_IN:lineType
txt_3 = Text(defaultvalue)

# ----
# Linear or Courtyard
# (LineString or Polygon)
panel_3 = Panel("Polygon")
tmatch = MatchText(Text=txt_3, RegEx=panel_3, Case=True)
filter = StreamFilter(Gate=tmatch, Stream0="0", Stream1="1")
typology = Number(filter)

# ----
# Levels
# (European)
defaultvalue_2 = Panel("2")
defaultvalue_3 = Panel("double loaded")
buildingdepth_m_2 = Number(buildingdepth_m)
corridorwidth_m_2 = Number(corridorwidth_m)
randcombinerooms = Number(randomreduceby)
floor_height = Number(floorheight)

# ---- group: RH_OUT:x
data = Data(txt)

# ---- group: RH_OUT:y
data_2 = Data(txt_2)

# ---- group: RH_IN:levels
int = Integer(defaultvalue_2)

# ----
defaultpts = Data(Tree({0;0;0}: [-43.78647637, 36.29287099], {0;0;1}: [79.60457781, 45.09542952], {0;0;2}: [40.42267925, -46.10201195], {0;0;3}: [-76.24078068, -37.29945342]))
division = Division(A=buildingdepth_m_2, B=2)
division_2 = Division(A=corridorwidth_m_2, B=2)
X = Data(flatten(txt))
Y = Data(flatten(txt_2))

# ---- group: RH_IN:corridor
num_3 = Number("1")

# ----
_0_5_buildingdepth_m = Number(division)
_0_5corridordepth_m = Number(division_2)

# ----
# Single or Double Corridor
int_2 = Integer(num_3)

pt = ConstructPoint(XCoordinate=X, YCoordinate=Y, ZCoordinate=0)
typology_2 = Number(filter)
pline = PolyLine(Vertices=pt, Closed=typology_2)
_0_5_corridordepth_m = Number(_0_5corridordepth_m)
neg = Negative(Value=_0_5_corridordepth_m)
offset = OffsetCurve(Curve=pline, Distance=[_0_5_corridordepth_m, neg], Corners=1)  # -> flatten(Curve)
centerline = Geometry(pline)
item = ListItem(List=offset, Index=0, Wrap=True)  # -> Item, Item1
_0_5_buildingdepth_m_2 = Number(_0_5_buildingdepth_m)
neg_2 = Negative(Value=_0_5_buildingdepth_m_2)
offset_2 = OffsetCurve(Curve=item.Item1, Distance=neg_2, Corners=1)  # -> flatten(Curve)
offset_3 = OffsetCurve(Curve=item.Item, Distance=_0_5_buildingdepth_m_2, Corners=1)  # -> flatten(Curve)
corridor = Number(int_2)

# ----
# buildingSrfMinusCorridor
loft = Loft(
    Curves=[offset_3, item.Item],
    Options={Adjust=False, Closed=False, LoftEnds=0, LoftSimp=0, LoftType=0, Rebuild=10, Refit=0.01})
loft_2 = Loft(
    Curves=[offset_2, item.Item1],
    Options={Adjust=False, Closed=False, LoftEnds=0, LoftSimp=0, LoftType=0, Rebuild=10, Refit=0.01})
boundary = BoundarySurfaces(Edges=[item.Item, offset_3])
boundary_2 = BoundarySurfaces(Edges=[item.Item1, offset_2])
filter_2 = StreamFilter(Gate=corridor, Stream0=loft, Stream1=[loft_2, loft])
filter_3 = StreamFilter(Gate=corridor, Stream0=boundary, Stream1=[boundary, boundary_2])
typology_3 = Number(filter)
filter_4 = StreamFilter(Gate=typology_3, Stream0=filter_2, Stream1=filter_3)

corridor_2 = Number(int_2)

# ----
# buildingOutlineCrv
merge = Merge(Data1=offset_3, Data2=item.Item1)
merge_2 = Merge(Data1=offset_3, Data2=offset_2)
filter_5 = StreamFilter(Gate=corridor_2, Stream0=merge, Stream1=merge_2)

# ----
# cutCrvs
panel_4 = Panel("5")
divdist = DivideDistance(Curve=centerline, Distance=panel_4)  # -> Points, Tangents, Parameters
panel_5 = Panel("""0
-1""")
cull_i = CullIndex(List=divdist.Points, Indices=panel_5, Wrap=True)
pull = PullPoint(Point=cull_i, Geometry=graft(filter_5), ClosestOnly=True)  # -> ClosestPoint, Distance
ln = Line(StartPoint=cull_i, EndPoint=pull.ClosestPoint)

# ----
# corridorSrf
loft_3 = Loft(Curves=offset, Options={Adjust=False, Closed=False, LoftEnds=0, LoftSimp=0, LoftType=0, Rebuild=10, Refit=0.01})
boundary_3 = BoundarySurfaces(Edges=offset)
typology_4 = Number(filter)
filter_6 = StreamFilter(Gate=typology_4, Stream0=loft_3, Stream1=boundary_3)

typology_5 = Number(filter)

# ----
# Random Reduce
# Make Larger Rooms
linearrandreduce = Slider(32, range=0..100)
courtyardrandreduce = Slider(5, range=0..10)
division_3 = Division(A=linearrandreduce, B="2")
split = SplitWithBrep(Curve=simplify(ln), Brep=filter_6)  # -> Curve, Points
filter_7 = StreamFilter(Gate=typology_5, Stream0=division_3, Stream1=courtyardrandreduce)
item_2 = ListItem(List=split.Curve, Index="1", Wrap=True)
reduce = RandomReduce(List=flatten(item_2), Reduction=filter_7, Seed=1)

# ----
# Clean Up Corners
end = EndPoints(Curve=reduce)  # -> Start, End
cullpt = CullDuplicates(Points=end.End, Tolerance=0.1, CullMode=3)  # -> Points, Indices, Valence
item_3 = ListItem(List=reduce, Index=cullpt.Indices, Wrap=True)

# ----
# demisingCrvs
building_boundary_srf = Surface(filter_4)

# ---- group: Corridor Curves
crv = Curve(flatten(offset))

# ---- group: Demising
crv_2 = Curve(item_3)

# ----
merge_3 = Merge(Data1=crv_2, Data2=crv)  # -> flatten(Result)

# ----
# Sort out Corridor
midpt = CurveMiddle(Curve=centerline)
srfsplit = SurfaceSplit(Surface=building_boundary_srf, Curves=merge_3)
srf_cp = SurfaceClosestPoint(Point=midpt, Surface=srfsplit)  # -> Point, UVPoint, Distance
smaller = SmallerThan(FirstNumber=srf_cp.Distance, SecondNumber="1e-5")  # -> SmallerThan, OrEqualTo
dispatch = Dispatch(List=srfsplit, DispatchPattern=smaller.SmallerThan)  # -> ListA, ListB

# ----
# Sort Surfaces Along Corridor Center Curve
area = Area(Geometry=dispatch.ListB)  # -> Area, Centroid
pull_2 = PullPoint(Point=area.Centroid, Geometry=centerline, ClosestOnly=True)  # -> ClosestPoint, Distance
# corridorNodes
alongcrv = SortAlongCurve(Points=pull_2.ClosestPoint, Curve=centerline)  # -> Points, Indices
item_4 = ListItem(List=dispatch.ListB, Index=alongcrv.Indices, Wrap=True)

corridor_nodes = Point(alongcrv.Points)

len = Length(Curve=centerline)
division_4 = Division(A=len, B="120")
round = Round(Number=division_4)  # -> Nearest, Floor, Ceiling
divide = DivideCurve(Curve=centerline, Count=round.Ceiling, Kinks=False)  # -> Points, Tangents, Parameters

# ----
# Find Room Closest to Egress Points
geo = Geometry(item_4)
area_2 = Area(Geometry=geo)  # -> Area, Centroid
dist = Distance(PointA=area_2.Centroid, PointB=graft(divide.Points))
sort = SortList(Keys=dist, ValuesA=geo)  # -> Keys, ValuesA
cull_i_2 = CullIndex(List=sort.ValuesA, Indices="0", Wrap=True)  # -> flatten(List)

# ---- group: Egress
item_5 = ListItem(List=sort.ValuesA, Index=0, Wrap=True)  # -> flatten(Item)

# ----
corridor_3 = Number(int_2)
area_3 = Area(Geometry=flatten(sort.ValuesA))  # -> Area, Centroid

# ---- group: Egress Nodes
area_4 = Area(Geometry=item_5)  # -> Area, Centroid

# ----
# egressNodes
floorheight_2 = Slider(4, range=0..10)
typology_6 = Number(typology)

cset = CreateSet(List=area_3.Centroid)  # -> Set, Map
mindex = MemberIndex(Set=cset.Set, Member=area_4.Centroid)  # -> Index, Count

levels = Number(int)
series = Series(Start=floorheight_2, Step=floorheight_2, Count=levels)  # -> flatten(Series)

# ---- group: roomNodes
cull_i_3 = CullIndex(List=cset.Set, Indices=flatten(mindex.Index), Wrap=True)

# ----
unit_z = UnitZ(Factor=series)  # -> simplify(graft(UnitVector))

cp = ClosestPoint(Point=cull_i_3, Cloud=flatten(corridor_nodes))  # -> ClosestPoint, CPIndex, Distance

# ---- group: Rooms Egdes
# roomEdges
line = Line(StartPoint=cull_i_3, EndPoint=cp.ClosestPoint)

# ---- group: Egress nodes
move = Move(Geometry=flatten(item_5), Motion=unit_z)  # -> Geometry, Transform
data_3 = Data([item_5, move.Geometry])
area_5 = Area(Geometry=data_3)  # -> Area, Centroid

# ----
data_4 = Data(flatten(line))
negative = Negative(Value=floorheight_2)

# ---- group: egressNodes
area_6 = Area(Geometry=move.Geometry)  # -> Area, Centroid

# ---- group: Room Edges
move_2 = Move(Geometry=flatten(data_4), Motion=graft(unit_z))  # -> Geometry, Transform

# ---- group: Room Nodes
move_3 = Move(Geometry=flatten(cull_i_3), Motion=graft(unit_z))  # -> Geometry, Transform

# ---- group: Room Nodes Per Level
entwine = Entwine(Branch0X=flatten(cull_i_3), Branch1X=simplify(move_3.Geometry), FlattenInputs=False)  # -> simplify(Result)

# ---- group: Room Edges Per Level
entwine_2 = Entwine(Branch0X=flatten(data_4), Branch1X=simplify(move_2.Geometry), FlattenInputs=False)  # -> simplify(Result)

# ---- group: verticalEgress
line_sdl = LineSDL(Start=area_6.Centroid, Direction=Vector(0, 0, 1), Length=negative)

# ----
removedupcrv = RemoveDupCrv(relay=line_sdl)
removedupcrv_2 = RemoveDupCrv(relay=entwine_2)
cullpt_2 = CullDuplicates(Points=entwine, Tolerance=0.1, CullMode=3)  # -> Points, Indices, Valence
list_length = ListLength(List=flatten(cullpt_2.Points))

# ---- group: Room Nodes
point = Point(flatten(cullpt_2.Points))

# ----
# manualOutput.JSON
toggle = BooleanToggle(False)
path = FilePath("D:\IAAC\04_Thesis\git-calculatorapp-frontend\backendJames\assets\manualOutput.JSON")

# ---- group: Corridor edges
# Corridor Edges
explode = Explode(Curve=centerline, Recursive=True)  # -> Segments, Vertices
cull_duplicates = CullDuplicates(Points=corridor_nodes, Tolerance=0.1, CullMode=3)  # -> flatten(Points), Indices, Valence
cull_duplicates_2 = CullDuplicates(Points=corridor_nodes, Tolerance=0.1, CullMode=3)  # -> Points, Indices, Valence
point_2 = Point([explode.Vertices, cull_duplicates_2.Points])
curve_closest_point = CurveClosestPoint(Point=flatten(point_2), Curve=centerline)  # -> Point, Parameter, Distance
shatter = Shatter(Curve=centerline, Parameters=curve_closest_point.Parameter)
end_points = EndPoints(Curve=shatter)  # -> Start, End
point_3 = Point([end_points.Start, end_points.End])
cull_duplicates_3 = CullDuplicates(Points=point_3, Tolerance=0.1, CullMode=3)  # -> Points, Indices, Valence
filter_8 = StreamFilter(Gate=corridor_3, Stream0=cull_duplicates.Points, Stream1=cull_duplicates_3.Points)

# ---- group: Corridor edges / corridor Nodes
data_5 = Data(flatten(filter_8))

# ----
cp_2 = ClosestPoint(Point=area_4.Centroid, Cloud=flatten(data_5))  # -> ClosestPoint, CPIndex, Distance
pt_2 = Point(cp_2.ClosestPoint)
line_2 = Line(StartPoint=area_4.Centroid, EndPoint=cp_2.ClosestPoint)
point_list = PointList(Points=pt_2)
pt_3 = Point(area_4.Centroid)
# egressNodes
move_4 = Move(Geometry=flatten(pt_3), Motion=unit_z)  # -> Geometry, Transform
move_5 = Move(Geometry=flatten(line_2), Motion=unit_z)  # -> Geometry, Transform
merge_4 = Merge(Data1=flatten(pt_3), Data2=flatten(move_4.Geometry))
merge_5 = Merge(Data1=flatten(line_2), Data2=flatten(move_5.Geometry))
lng = ListLength(List=pt_3)
lng_2 = ListLength(List=line_2)

# ---- group: Corridor nodes
move_6 = Move(Geometry=flatten(data_5), Motion=graft(unit_z))  # -> Geometry, Transform

# ---- group: Corridor Nodes Per Level
entwine_3 = Entwine(Branch0X=flatten(data_5), Branch1X=simplify(move_6.Geometry), FlattenInputs=False)  # -> simplify(Result)

# ---- group: Egress Nodes Per Level
partition = PartitionList(List=merge_4, Size=lng)  # -> simplify(Chunks)

# ---- group: Egress Edges Per Level
partition_2 = PartitionList(List=merge_5, Size=lng_2)  # -> simplify(Chunks)

# ----
removedupcrv_3 = RemoveDupCrv(relay=partition_2)
# removeDup
cullpt_3 = CullDuplicates(Points=partition, Tolerance=0.1, CullMode=3)  # -> Points, Indices, Valence
cullpt_4 = CullDuplicates(Points=entwine_3, Tolerance=0.1, CullMode=3)  # -> Points, Indices, Valence
allegressedges = Curve(flatten([removedupcrv, removedupcrv_3]))
list_length_2 = ListLength(List=flatten(cullpt_3.Points))
list_length_3 = ListLength(List=flatten(cullpt_4.Points))
merge_6 = Merge(Data1=flatten(cullpt_2.Points), Data2=flatten(cullpt_3.Points), Data3=flatten(cullpt_4.Points))
item_index = ItemIndex(List=merge_6, Item=merge_6)  # disabled
deconstruct = Deconstruct(Point=merge_6)  # -> XComponent, YComponent, ZComponent

# ---- group: LIST LENGTH FOR EACH EDGE CATEGORY
merge_7 = Merge(Data1=list_length, Data2=list_length_2, Data3=list_length_3)

# ---- group: Corridor Nodes
point_4 = Point(flatten(cullpt_4.Points))

# ---- group: Egress Edge Weights
len_2 = Length(Curve=flatten(allegressedges))

# ---- group: Corridor edges (continued)
shift_list = ShiftList(List=data_5, Shift=1, Wrap=True)
cull_index = CullIndex(List=shift_list, Indices="-1", Wrap=True)
dispatch_2 = Dispatch(List=data_5, DispatchPattern=[True, False])  # -> ListA, ListB
line_3 = Line(StartPoint=dispatch_2.ListA, EndPoint=dispatch_2.ListB)

# ----
filter_9 = StreamFilter(Gate=typology_6, Stream0=cull_index, Stream1=shift_list)

# ---- group: Corridor edges (continued)
dispatch_3 = Dispatch(List=filter_9, DispatchPattern=[True, False])  # -> ListA, ListB
# roomNodes
line_4 = Line(StartPoint=dispatch_3.ListA, EndPoint=dispatch_3.ListB)
weave = Weave(Pattern=[0, 1], Stream0=line_3, Stream1=line_4, NullGaps=False)

# ----
# corridorEdges
corridoredges = Curve(weave)

# ---- group: Corridor Edges
move_7 = Move(Geometry=flatten(corridoredges), Motion=graft(unit_z))  # -> Geometry, Transform

# ---- group: Corridor Edges Per Level
entwine_4 = Entwine(Branch0X=flatten(corridoredges), Branch1X=simplify(move_7.Geometry), FlattenInputs=False)  # -> simplify(Result)

# ----
removedupcrv_4 = RemoveDupCrv(relay=entwine_4)

# ---- group: Corridor Weight
length = Length(Curve=removedupcrv_4)

# ----
alledges = Data([removedupcrv_4, removedupcrv_2, removedupcrv, removedupcrv_3])
collision_one_many = CollisionOneMany(Collider=flatten(alledges), Obstacles=graft(merge_6))  # -> Collision, Index
mass_addition = MassAddition(Input=collision_one_many.Collision)  # -> flatten(Result), PartialResults

# ---- group: Corridor Weight
num_4 = Number(flatten(length))

# ----
partition_3 = PartitionList(List=item_index, Size=merge_7)  # disabled
bang = ExplodeTree(Data=simplify(partition_3))  # -> Branch0, Branch1, Branch2; disabled
cp_3 = ClosestPoint(Point=point, Cloud=point_4)  # -> ClosestPoint, CPIndex, Distance
ln_2 = Line(StartPoint=point, EndPoint=cp_3.ClosestPoint)

# ---- group: Room Node ID
data_6 = Data(bang.Branch0)  # disabled

# ---- group: Corridor Node ID
data_7 = Data(bang.Branch2)  # disabled

# ----
item_6 = ListItem(List=data_7, Index=cp_3.CPIndex, Wrap=True)  # disabled

merge_8 = Merge(Data1=flatten(ln_2), Data2=flatten(allegressedges), Data3=flatten(removedupcrv_4))
end_2 = EndPoints(Curve=merge_8)  # -> Start, End
entwine_5 = Entwine(Branch00=end_2.Start, Branch01=end_2.End, FlattenInputs=True)
flip = FlipMatrix(Data=entwine_5)  # -> simplify(Data)
pdecon = Deconstruct(Point=flip)  # -> XComponent, YComponent, ZComponent
pdecon_2 = Deconstruct(Point=merge_6)  # -> XComponent, YComponent, ZComponent
python = GhPythonScript(
    vx=pdecon.XComponent,
    vy=pdecon.YComponent,
    vz=pdecon.ZComponent,
    x=pdecon_2.XComponent,
    y=pdecon_2.YComponent,
    z=pdecon_2.ZComponent)  # -> out, simplify(edge_verticies); inputs vx: tree, vy: tree, vz: tree, x: list, y: list, z: list
# ---------- python: Python ----------
import rhinoscriptsyntax as rs
import Rhino.Geometry as rg
import ghpythonlib.treehelpers as th
import Rhino.RhinoMath as rm

vx=th.tree_to_list(vx,None)
vy=th.tree_to_list(vy,None)
vz=th.tree_to_list(vz,None)

epsilon=0.0000000001
edge_verticies=[]
for i in range(len(vx)):
    for j in range(len(x)):
        if rm.EpsilonEquals(vx[i][0],x[j],epsilon) and rm.EpsilonEquals(vy[i][0],y[j],epsilon) and rm.EpsilonEquals(vz[i][0],z[j],epsilon):
            first_node=j
        else:
            pass
        if rm.EpsilonEquals(vx[i][1],x[j],epsilon) and rm.EpsilonEquals(vy[i][1],y[j],epsilon) and rm.EpsilonEquals(vz[i][1],z[j],epsilon):
            second_node=j
        else:
            pass
    edge_verticies.append([first_node,second_node])
    
edge_verticies=th.list_to_tree(edge_verticies)
# ---------- end python ----------
panel_6 = Panel(pdecon.YComponent)

# ---- group: Room To Corridor Edge Length / Weight
len_3 = Length(Curve=ln_2)

# ---- group: Weights
merge_9 = Merge(Data1=flatten(len_3), Data2=flatten(len_2), Data3=flatten(num_4))  # -> simplify(graft(Result))

# ----
lng_3 = ListLength(List=len_2)
lng_4 = ListLength(List=merge_9)

# ----
# OUTPUT
python_2 = GhPythonScript(
    x=flatten(deconstruct.XComponent),
    y=flatten(deconstruct.YComponent),
    z=flatten(deconstruct.ZComponent),
    nodeDegree=flatten(mass_addition.Result),
    v=python.edge_verticies,
    edgeFeatures=flatten(merge_9))  # -> out, output, flatten(json_string); inputs x: list, y: list, z: list, nodeDegree: list, v: tree, edgeFeatures: list
# ---------- python_2: Python ----------
__author__ = "REN"
__version__ = "2023.08.19"

import rhinoscriptsyntax as rs
import ghpythonlib.treehelpers as th
import json

data_dict = {}
edge_dict = {}
node_dict = {}
edge_array = []
node_array = []

#if not isinstance(v, list):  # replace type_expected_for_tree with the expected type
#    print("v is not a tree!")
#else:
v = th.tree_to_list(v, None)
# edgeFeatures = th.tree_to_list(edgeFeatures, None)
c = 0

for i in range(len(v)):
    edge_dict = {
        "edge": {
            "type": "object",
            "additionalProperties": False,
            "properties": {
                "id": c,
                "source": v[i][0],
                "target": v[i][1],
                "metadata": {
                    "length": edgeFeatures[i]
                }
            }
        }
    }
    edge_array.append(edge_dict)
    c+=1

c = 0
for i in range(len(x)):
    node_dict = {
        "node": {
            "type": "object",
            "properties": {
                "label": c,
                "degree": nodeDegree[i],
                "metadata": {
                    "type": "Feature",
                    "geometry": {
                        "type": "Point",
                        "coordinates": [x[i], y[i], z[i]]
                    }
                }
            }
        }
    }
    node_array.append(node_dict)
    c+=1

data_dict = {"title": "Graph Start",
"type": "FeatureCollection",
"features": node_array + edge_array
}
data_str = str(data_dict)
data_clean = data_str.replace("'", '"')

output = data_clean
json_string = json.dumps(data_dict)
# ---------- end python_2 ----------

# ---- group: RH_OUT:output
data_8 = Data(python_2.output)

# ==== cluster RemoveDupCrv
relay = ClusterInput()
midpt = CurveMiddle(Curve=relay)
cullpt = CullDuplicates(Points=midpt, Tolerance=0.1, CullMode=3)  # -> Points, Indices, Valence
item = ListItem(List=relay, Index=cullpt.Indices, Wrap=True)
end = EndPoints(Curve=item)  # -> Start, End
ln = Line(StartPoint=end.Start, EndPoint=end.End)
L = ClusterOutput(ln)
